# Dynamo graph Purging Line Patterns.dyn "01 - Purging Line Patterns" (Dynamo 2.0.4.12684)

categories = Categories(index=256)
all_elements_of_category = ElementsOfCategory(Category=categories)
name = Element.Name(element=all_elements_of_category)
checking_names_of_all_line = Watch(name)  # "Checking Names of All Line Patterns"

# group: Creating a Boolean where Line Patterns including "IMPORT" (from CAD) will return 'true', This way we can create a separate list to purge them out.
code_block = CodeBlock { "IMPORT"; }
code_block_2 = CodeBlock { false; }
contains = String.Contains(str=name, searchFor=code_block, ignoreCase=code_block_2)
watch = Watch(contains)

filterByBoolMask = List.FilterByBoolMask(list=name, mask=contains)
watch_2 = Watch(filterByBoolMask.out)
watch_3 = Watch(filterByBoolMask.in)
element_types = ElementTypes(index=174)
all_elements_of_type = ElementsOfType(element_type=element_types)
filterByBoolMask_2 = List.FilterByBoolMask(list=all_elements_of_type, mask=contains)
watch_4 = Watch(filterByBoolMask_2.in)
name_2 = Element.Name(element=watch_4)

# group: This is abundance, but there's no harm in double checking.
import_check = Watch(name_2)

# group: PLEASE MAKE SURE YOU DISCONNECT THE ELEMENT.DELETE BEFORE SAVING OR RUNNING TO CHECK NAMES
watch_5 = Watch()  # unwired: arg0

# group: Package from Archi-lab
delete = archilab.Revit.Elements.Elements.Delete()  # unwired: element
