# Dynamo graph Move Room Without Plug-in.dyn (Dynamo 2.13.1.3887)

# note: RUN THIS TOP BITS FIRST

# group: Get The Rooms
categories = Categories("OST_Rooms")  # graph input
all_elements_of_category = ElementsOfCategory(Category=categories)

# group: This is needed to modify position of elements inside Revit
start = Revit.Transaction.Transaction.Start(input=all_elements_of_category)

location = Room.Location(room=all_elements_of_category)

# group: Draw the outline of the rooms, then find the centroid
centerBoundary = Room.CenterBoundary(room=all_elements_of_category)
byJoinedCurves = PolyCurve.ByJoinedCurves(curves=centerBoundary)
extrudeAsSolid = Curve.ExtrudeAsSolid(curve=byJoinedCurves)
centroid = Solid.Centroid(solid=extrudeAsSolid)

# group: Creating a vector between two sets of points
byTwoPoints = Vector.ByTwoPoints(start=location, end=centroid)

moveByVector = Element.MoveByVector(element=start, vector=byTwoPoints)
watch = Watch(moveByVector)

# group: Get The RoomTags
categories_2 = Categories("OST_RoomTags")  # graph input
all_elements_of_category_2 = ElementsOfCategory(Category=categories_2)

start_2 = Revit.Transaction.Transaction.Start(input=all_elements_of_category_2)
getLocation = Element.GetLocation(element=all_elements_of_category_2)
# note: UNFREEZE ME
byTwoPoints_2 = Vector.ByTwoPoints(start=getLocation, end=centroid)  # frozen
start_3 = Revit.Transaction.Transaction.Start(input=byTwoPoints_2)
moveByVector_2 = Element.MoveByVector(element=start_2, vector=start_3)
watch_2 = Watch(all_elements_of_category_2)
