# Dynamo graph Door Script.dyn (Dynamo 2.16.1.2727)

levels = Levels("Level 0")

# group: SORT BY LEVEL
all_elements_at_level = ElementsAtLevel(Level=levels)
getCategory = Element.GetCategory(element=all_elements_at_level)
string_from_object = FromObject(obj=getCategory)
code_block = CodeBlock { "Door"; }
startsWith = String.StartsWith(string=string_from_object, searchFor=code_block)
filterByBoolMask = List.FilterByBoolMask(list=all_elements_at_level, mask=startsWith)
flatten = List.Flatten(list=filterByBoolMask.in)

all_elements_at_level_2 = ElementsAtLevel(Level=levels)
getCategory_2 = Element.GetCategory(element=all_elements_at_level_2)
string_from_object_2 = FromObject(object=getCategory_2)
categories = Categories("OST_Areas")
string_from_object_3 = FromObject(object=categories)
eq = string_from_object_2 == string_from_object_3
filterByBoolMask_2 = List.FilterByBoolMask(list=all_elements_at_level_2, mask=eq)
boundaries = Area.Boundaries(area=filterByBoolMask_2.in)
code_block_2 = CodeBlock { 2000; }
byJoinedCurves = PolyCurve.ByJoinedCurves(curves=boundaries, joinTolerance=code_block_2)
number_slider = DoubleSlider(1, range=0..100 step 1)
getItemAtIndex = List.GetItemAtIndex(list=byJoinedCurves, index=number_slider)
boundingBox = Geometry.BoundingBox(geometry=getItemAtIndex@L2)
getLocation = Element.GetLocation(element=flatten)
contains = BoundingBox.Contains(boundingBox=boundingBox, point=getLocation@L4)
flatten_2 = List.Flatten(list=contains)
filterByBoolMask_3 = List.FilterByBoolMask(list=flatten, mask=flatten_2)

# group: Spline Control
select_model_element = DSModelElementSelection()  # 1 picked in the model
curves = Element.Curves(element=select_model_element)
code_block_3 = CodeBlock { 0..1..#80; }
pointAtParameter = Curve.PointAtParameter(curve=curves, param=code_block_3, lacing=Longest)
code_block_4 = CodeBlock { false; }
byPoints = PolyCurve.ByPoints(points=pointAtParameter, connectLastToFirst=code_block_4)
getLocation_2 = Element.GetLocation(element=filterByBoolMask_3.in)
closestPointTo = Geometry.ClosestPointTo(geometry=byPoints, other=getLocation_2)
parameterAtPoint = Curve.ParameterAtPoint(curve=byPoints, point=closestPointTo)
sortByKey = List.SortByKey(list=filterByBoolMask_3.in, keys=parameterAtPoint)

code_block_5 = CodeBlock { "DB.1.1"; }

# group: Count and create a sequence
count = List.Count(list=filterByBoolMask_3.in)
code_block_6 = CodeBlock(input=count) { 1..#input..1; }

string_from_object_4 = FromObject(object=code_block_6)
add = code_block_5 + string_from_object_4

# group: Depends on the type of parameters you'd use intergers or strings.
code_block_7 = CodeBlock { "Mark"; }
watch = Watch(add)

setParameterByName = Element.SetParameterByName(element=sortByKey.sortedList, parameterName=code_block_7, value=add)
name = Element.Name(element=filterByBoolMask_2.in)
watch_2 = Watch(name)
getItemAtIndex_2 = List.GetItemAtIndex(list=name, index=number_slider)
watch_3 = Watch(getItemAtIndex_2)
