# Dynamo graph GROUPS REVIEW.dyn (Dynamo 2.16.1.2727)

# note: •  •  •  •  •  •  •  •  •  •  •  •  •  •  •  •  •  •  •  •  •  •  •  •

# group: Do a last eye check before connecting this node in
delete = Element.Delete()  # unwired: element

# group: GROUPS THAT ARE PLACED IN THE DOCUMENT
python_script = Python()  # CPython3; unwired: IN[0]
# ---------- python_script.python (31 lines) ----------
#HAO THANH (GEOFFERY) PHUNG@K2LD

import clr
clr.AddReference('ProtoGeometry')
from Autodesk.DesignScript.Geometry import *

# Import DocumentManager and TransactionManager
clr.AddReference("RevitServices")
import RevitServices
from RevitServices.Persistence import DocumentManager
from RevitServices.Transactions import TransactionManager

# Import RevitAPI
clr.AddReference("RevitAPI")
import Autodesk
from Autodesk.Revit.DB import *

doc = DocumentManager.Instance.CurrentDBDocument
uiapp = DocumentManager.Instance.CurrentUIApplication
app = uiapp.Application

#The inputs to this node will be stored as a list in the IN variable.
dataEnteringNode = IN

groups = FilteredElementCollector(doc).OfClass(GroupType)
unplacedGroups = []
for i in groups:
        gInstances = i.Groups
        if gInstances.IsEmpty == 0:
                unplacedGroups.append(i)
OUT = unplacedGroups
# ----------------------------------------
watch = Watch(python_script)

name = Element.Name(element=python_script)
watch_2 = Watch(name)

# group: GROUPS IN THE REVIT FILE
python_script_2 = Python()  # CPython3; unwired: IN[0]
# ---------- python_script_2.python (29 lines) ----------
#HAO THANH (GEOFFERY) PHUNG@K2LD

import clr
clr.AddReference('ProtoGeometry')
from Autodesk.DesignScript.Geometry import *

# Import DocumentManager and TransactionManager
clr.AddReference("RevitServices")
import RevitServices
from RevitServices.Persistence import DocumentManager
from RevitServices.Transactions import TransactionManager

# Import RevitAPI
clr.AddReference("RevitAPI")
import Autodesk
from Autodesk.Revit.DB import *

doc = DocumentManager.Instance.CurrentDBDocument
uiapp = DocumentManager.Instance.CurrentUIApplication
app = uiapp.Application

#The inputs to this node will be stored as a list in the IN variable.
dataEnteringNode = IN

groups = FilteredElementCollector(doc).OfClass(GroupType)
grouplist = []
for i in groups:
        grouplist.append(i)
OUT = grouplist
# ----------------------------------------
watch_3 = Watch(python_script_2)

name_2 = Element.Name(element=python_script_2)
watch_4 = Watch(name_2)
setDifference = List.SetDifference(list1=watch_3, list2=watch)
name_3 = Element.Name(element=setDifference)
watch_5 = Watch(name_3)
element_classes = ElementTypes("Group")
all_elements_of_class = ElementsOfType(element_class=element_classes)
name_4 = Element.Name(element=all_elements_of_class)

# group: Collection of Group Names
# note: •  •  •  •  •  •  •  •  •  •  •  •  •  •  •  •  •  •  •  •  •  •  •  •
watch_6 = Watch(name_4)

uniqueItems = List.UniqueItems(list=name_4)

# group: Collection of Unique Groups
watch_7 = Watch(uniqueItems)

identity = Object.Identity()  # unwired: object
groupByFunction = List.GroupByFunction(list=name_4, groupFunction=identity)
count = List.Count(list=groupByFunction, lacing=Longest)

# group: Count the number of placed group instances
watch_8 = Watch(count)
