# Dynamo graph Parking Script.dyn (Dynamo 2.0.4.12684)

# group: Gathering ALL Parking Elements in the Project
categories = Categories(index=332)

levels = Levels(index=1)
byCategoryAndLevel = archilab.Revit.Selection.Select.ByCategoryAndLevel(category=categories, level=levels)

# group (continued): Gathering ALL Parking Elements in the Project
name = Element.Name(element=byCategoryAndLevel)

# group: Type the Type Mark here EXACT (it's case sensitive)
code_block = CodeBlock { "4900 x 2600 (6.4M)"; }

# group: Filtering the Parking Type
startsWith = String.StartsWith(str=name, searchFor=code_block)

# group: Plug from in to element if want to sort chronologically
filterByBoolMask = List.FilterByBoolMask(list=byCategoryAndLevel, mask=startsWith)

# group: Creating a sequence of number
code_block_2 = CodeBlock { 1; }
# note: Sequence of number is important here, because this block basically let you re-check the number of elements you're renumbering. (List Count)
# The starting number would be 1 and the increment would also be 1 (That's why I plug both in)
count = List.Count(list=filterByBoolMask.in)
sequence = Sequence(start=code_block_2, amount=count, step=code_block_2)

# group: Assign Parking Number Ascending Order (Number depends on which on you placed first)
# note: In case the numbering is wrong...
# Cut all the carparks and tags to an empty file and run the script there...REVIT IS WEIRD. I've tried to trobleshoot this to no avail...
code_block_3 = CodeBlock { "Carpark_Number"; }
setParameterByName = Element.SetParameterByName(parameterName=code_block_3, value=sequence)  # unwired: element

# group: Getting Locations of the Parkings
getLocation = Element.GetLocation(element=filterByBoolMask.in)

# group: Reorder based on position of the parking instead of chronologically.
# note: This basically spits out element(for the elemID and selections etc),x, y and z seperately. This way we could use a short python script to order them.
code_block_4 = CodeBlock(elem=filterByBoolMask.in, pt=getLocation) { Transpose([elem,Math.Round(pt.X,2),Math.Round(-pt.Y,2), Math.Round(pt.Z,2)]); }
python_script = Python(IN[0]=code_block_4)
# ---------- python_script.python (4 lines) ----------
import clr
from operator import itemgetter
orglst = IN[0]
OUT = sorted(orglst, key=itemgetter(1,2,3))
# ----------------------------------------
code_block_5 = CodeBlock { 0; }

# group: Plug from item to element if want to sort xyz
getItemAtIndex = List.GetItemAtIndex(list=python_script@L2, index=code_block_5)

watch = Watch(filterByBoolMask.in)
