# Dynamo graph Parking Script.dyn (Dynamo 2.16.1.2727)

# group: SORT BY LEVEL
levels = Levels("Level 0")
all_elements_at_level = ElementsAtLevel(Level=levels)
getCategory = Element.GetCategory(element=all_elements_at_level)
string_from_object = FromObject(obj=getCategory)
code_block = CodeBlock { "Parking"; }
startsWith = String.StartsWith(string=string_from_object, searchFor=code_block)
filterByBoolMask = List.FilterByBoolMask(list=all_elements_at_level, mask=startsWith)
flatten = List.Flatten(list=filterByBoolMask.in)

# group: FILTERING OUT THE TYPE OF PARKING YOU DON'T WANT
string_from_object_2 = FromObject(object=flatten)
family_name_in_between_____here = CodeBlock { "4900 x 2600 (6.4M) no wheel stop"; }
contains = String.Contains(string=string_from_object_2, searchFor=family_name_in_between_____here)
not_ = Not(x=contains)
filterByBoolMask_2 = List.FilterByBoolMask(list=flatten, mask=not_)

# group: Detail line spline redrawn in Dynamo
select_model_element = DSModelElementSelection()  # 1 picked in the model
curves = Element.Curves(element=select_model_element)
code_block_2 = CodeBlock { 0..1..#80; }
pointAtParameter = Curve.PointAtParameter(curve=curves, param=code_block_2, lacing=Longest)
code_block_3 = CodeBlock { false; }
byPoints = PolyCurve.ByPoints(points=pointAtParameter, connectLastToFirst=code_block_3)

getLocation = Element.GetLocation(element=filterByBoolMask_2.out)
closestPointTo = Geometry.ClosestPointTo(geometry=byPoints, other=getLocation)
parameterAtPoint = Curve.ParameterAtPoint(curve=byPoints, point=closestPointTo)
sortByKey = List.SortByKey(list=filterByBoolMask_2.out, keys=parameterAtPoint)

# group: Count and create a sequence
count = List.Count(list=sortByKey.sortedList)
code_block_4 = CodeBlock(input=count) { 1..#input..1; }

# group: Depends on the type of parameters you'd use intergers or strings.
code_block_5 = CodeBlock { "Carpark_Number"; }
string_from_object_3 = FromObject(obj=code_block_4)

setParameterByName = Element.SetParameterByName(element=sortByKey.sortedList, parameterName=code_block_5, value=code_block_4)

# group: SORT BY VIEW
categories = Categories("OST_Parking")
all_elements_of_category_in_view = ElementsOfCategoryInView(Category=categories)  # unwired: View
watch = Watch(all_elements_of_category_in_view)
