# Dynamo graph 02 - Remove Unused View Filter.dyn (Dynamo 2.0.1.5055)

# group: Getting All The Views In The Project indiscriminately.....
categories = Categories(index=602)
all_elements_of_category = ElementsOfCategory(Category=categories)
boolean = BoolSelector(false)
clean = List.Clean(list=all_elements_of_category, preserveIndices=boolean)
watch = Watch(clean)

# group: View Filters Throughout All the Views in the Project
filters = View.Filters(view=clean)
watch_2 = Watch(filters)
flatten = List.Flatten(list=filters)
watch_3 = Watch(flatten)

# group: View Filters That Are In USE
uniqueItems = List.UniqueItems(list=flatten)
name = Element.Name(element=uniqueItems)
watch_4 = Watch(name)

# group: All View Filters In The Project
element_types = ElementTypes(index=127)
all_elements_of_type = ElementsOfType(element_type=element_types)
name_2 = Element.Name(element=all_elements_of_type)
watch_5 = Watch(name_2)

indexOf = List.IndexOf(list=all_elements_of_type, element=uniqueItems)
watch_6 = Watch(indexOf)

# group: Filters to be removed
removeItemAtIndex = List.RemoveItemAtIndex(list=all_elements_of_type, indices=indexOf)
watch_7 = Watch(removeItemAtIndex)

delete = archilab.Revit.Elements.Elements.Delete(element=removeItemAtIndex)
