# Dynamo graph 02 - Remove Unused View Template.dyn (Dynamo 2.0.1.5055)

# group: Getting All The Views In The Project indiscriminately.....
categories = Categories(index=602)
all_elements_of_category = ElementsOfCategory(Category=categories)
boolean = BoolSelector(false)
clean = List.Clean(list=all_elements_of_category, preserveIndices=boolean)
watch = Watch(clean)

isViewTemplate = Custom[View.IsViewTemplate+](view=clean)  # Checks if a given view is a view template. Unlike the OOTB node it works for all view types.
watch_2 = Watch(isViewTemplate)
filterByBoolMask = List.FilterByBoolMask(list=clean, mask=isViewTemplate)
watch_3 = Watch(filterByBoolMask.in)
watch_4 = Watch(filterByBoolMask.out)
viewTemplate = Custom[View.ViewTemplate](view=clean)  # Returns the view template assigned to a given view (if one is assigned)
watch_5 = Watch(viewTemplate)
code_block = CodeBlock { "View Template"; }
getParameterValueByName = Element.GetParameterValueByName(element=filterByBoolMask.out, parameterName=code_block)
watch_6 = Watch(getParameterValueByName)
setDifference = List.SetDifference(list1=filterByBoolMask.in, list2=getParameterValueByName)
watch_7 = Watch(setDifference)
delete = archilab.Revit.Elements.Elements.Delete()  # unwired: element
