# Dynamo graph RenameViewsFromBrowser.dyn (Dynamo 2.11.1.4675)
# packages: spring nodes 204.1.0, Clockwork for Dynamo 2.x 2.3.0

# group: Control
# note: For sliders and other options

# group: To Revit
# note: For changes made to Revit

# group: Annotation
# note: For notes and titles

# group: Info
# note: For general Information

# group: Other
# note: For general other needs

# group: Input
# note: For selection and whatnot

# group: Background
# note: For workflow

# group: License
# note: GNU License
# This program is free software: you can redistribute it and/or modify it under the terms of the GNU General Public License as published by the Free Software Foundation, either version 3 of the License, or (at your option) any later version.
# This program is distributed in the hope that it will be useful, but WITHOUT ANY WARRANTY; without even the implied warranty of MERCHANTABILITY or FITNESS FOR A PARTICULAR PURPOSE. See the GNU General Public License for more details.
# You should have received a copy of the GNU General Public License along with this program. If not, see http://www.gnu.org/licenses/

# group: Information
description = StringInput("This will get the current selection from the project browser and rename according to the criteria below.")  # graph input

# group: Get the current selection from the browser and the name of the element
# note: Custom Node: spring nodes v.204.1.0
ꟿ_collect_currentselection = Custom[ꟿ Collect.CurrentSelection]()  # package spring nodes; Gets the currently selected elements. Connect a boolean switch to refresh the selection.
name = Element.Name(element=ꟿ_collect_currentselection)

# group: Input
prefix = StringInput("")  # graph input
suffix = StringInput("")  # graph input
find = StringInput("")  # graph input
replace = StringInput("")  # graph input

# group: Builds the new name based on criteria
code_block = CodeBlock(pre=prefix, originalName=name, suf=suffix) { pre + originalName + suf; }
# note: Custom Node: Clockwork v.2.3.0
replaceMultiple = Custom[String.ReplaceMultiple](str=code_block, searchFor=find, replaceWith=replace)  # package Clockwork for Dynamo 2.x; Replaces multiple search terms in a given string with multiple replacements

# group: To Revit
# note: Custom Node: Clockwork v.2.3.0
setName = Custom[Element.SetName](element=ꟿ_collect_currentselection, name=replaceMultiple)  # package Clockwork for Dynamo 2.x; Gets the name of a given Revit element
